# Grasshopper definition Image_to_CAD.gh (Grasshopper 1.0.8)
# plug-ins: AI_Tools Info

panel = Panel("sk-634DCZNUzA6IJ8KgcSOia5w1ylULijc2gfVKLHoXavT3BlbkFJ3DK0ZBfVaxBBXJ0B9-lMIBmhNvR3YdAq0lKqRYvfYA")
file_path = FilePath("/Users/jorgemuyo/Desktop/AI_Tools/IMGS/AI_TOOLS.jpg")
image_to_prompt = ImageToPrompt(Generate=Button(), APIKey=panel, ImagePath=file_path, Model="gpt-4o-mini", MaxTokens=300, Timeout=60000)  # -> Prompt, Success
# Design a 2 piece 2*6 lego brick assembly
panel_2 = Panel(image_to_prompt.Success)
panel_3 = Panel(image_to_prompt.Prompt)
file_path_2 = FilePath("/Users/jorgemuyo/Desktop/")
text_to_cad = TextToCAD(
    Generate=Button(),
    APIKey="api-9df6f35f-22ff-418d-981e-291b2274219f",
    Prompt=panel_3,
    OutputDirectory=file_path_2,
    Format=2,
    KeepFile=Slider(0, range=0..100))  # -> Breps, FilePath, Success, Status
panel_4 = Panel(text_to_cad.Status)
panel_5 = Panel(text_to_cad.Success)
M = OllamaModels({"NAME", "gpt-oss:20b", "granite3.3:latest"}, selected="gpt-oss:20b")
component_that_makes_local = ComponentThatMakesLocal(
    Generate=False,
    Model=M,
    Category="AI Tools",
    Subcategory="LLM",
    Temperature=0.7,
    MaxTokens=2048,
    URL="http://localhost:11434/api/generate",
    Timeout=60000)  # -> GeneratedCode, ComponentClass, SourcePath, AssemblyPath, Success
